% Simulink data dictionary DdPassengerEv.sldd
% references DdChassis.sldd
% references DdDifferential.sldd
% references DdEnvironment.sldd
% references DdTireFront.sldd
% references DdTireRear.sldd
% references DdDriveCycleSrc.sldd
% references DdDriverLong.sldd
% references DdEvMotor.sldd
% references DdBattery_32Ah.sldd
% references DdConfigSets.sldd
% references DdEvSupervisoryCtrl.sldd
% references DdDynoRefAll.sldd
% references Dd_MTU_Map.sldd
% references DdExpRefSrc.sldd
% references CAVE_drivingCycle.sldd

Sig = Simulink.Signal()
InitSpeed = [20 0 0]
InitPos = [-34 0 0]
T_ADE = 0.01

SupvsryCtrlBus = Simulink.Bus()
  MtrTrqCmd: double
  AccelCmd: double
  BrkCmd: double
  DriverGearCmd: double
  SteeringCmd: double