% Simulink data dictionary DdExpRefSrc.sldd

ExpRefStructs = [struct(
  Name=[],
  time=[],
  accelPedalCmd=[],
  brakePedalCmd=[],
  accelPedalDBW=[],
  brakePedalDBW=[],
  vehSpd=[],
  battVolt=[],
  battSoc=[],
  battCurr=[],
  axleTorq=[],
  grade=[],
  brakeTorq=[],
  spare3=[],
  spare4=[],
  spare5=[],
  spare6=[]), struct(
  Name=[],
  time=[],
  accelPedalCmd=[],
  brakePedalCmd=[],
  accelPedalDBW=[],
  brakePedalDBW=[],
  vehSpd=[],
  battVolt=[],
  battSoc=[],
  battCurr=[],
  axleTorq=[],
  grade=[],
  brakeTorq=[],
  spare3=[],
  spare4=[],
  spare5=[],
  spare6=[]), struct(
  Name=[],
  time=[],
  accelPedalCmd=[],
  brakePedalCmd=[],
  accelPedalDBW=[],
  brakePedalDBW=[],
  vehSpd=[],
  battVolt=[],
  battSoc=[],
  battCurr=[],
  axleTorq=[],
  grade=[],
  brakeTorq=[],
  spare3=[],
  spare4=[],
  spare5=[],
  spare6=[]), struct(
  Name=[],
  time=[],
  accelPedalCmd=[],
  brakePedalCmd=[],
  accelPedalDBW=[],
  brakePedalDBW=[],
  vehSpd=[],
  battVolt=[],
  battSoc=[],
  battCurr=[],
  axleTorq=[],
  grade=[],
  brakeTorq=[],
  spare3=[],
  spare4=[],
  spare5=[],
  spare6=[]), struct(
  Name=[],
  time=[],
  accelPedalCmd=[],
  brakePedalCmd=[],
  accelPedalDBW=[],
  brakePedalDBW=[],
  vehSpd=[],
  battVolt=[],
  battSoc=[],
  battCurr=[],
  axleTorq=[],
  grade=[],
  brakeTorq=[],
  spare3=[],
  spare4=[],
  spare5=[],
  spare6=[]), struct(
  Name=[],
  time=[],
  accelPedalCmd=[],
  brakePedalCmd=[],
  accelPedalDBW=[],
  brakePedalDBW=[],
  vehSpd=[],
  battVolt=[],
  battSoc=[],
  battCurr=[],
  axleTorq=[],
  grade=[],
  brakeTorq=[],
  spare3=[],
  spare4=[],
  spare5=[],
  spare6=[]), struct(
  Name="Bolt 61910021 Test Data_ACM_Testing_RAW.csv",
  time=[0.099980831; 0.199980736; 0.29998064; 0.399980545; 0.49998045; 0.599980354; 0.699980259; 0.799980164; 0.899980068; 0.999979973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 4839.995365],
  accelPedalCmd=[0; 0; 0; 0; 0; 0; 0; 0; 0; 0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 0],
  brakePedalCmd=[0.17647065; 0.17647065; 0.17647065; 0.17647065; 0.17647065; 0.17647065; 0.17647065; 0.17647065; 0.17647065; 0.17647065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 0.17647065],
  accelPedalDBW=repmat(0, 48400, 1),
  brakePedalDBW=repmat(0, 48400, 1),
  vehSpd=[0.00027396354656; 0.000247104; 5.852066528e-5; 0.00032271459968; 0.0002061793184; 0.00032350854272; 0.00043392027008; 0.00037963843808; 0.00024479597472; 0.0003128743552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 0.000217831416],
  battVolt=[398.5449981; 398.5464086; 398.544743; 398.5453215; 398.5416348; 398.5421387; 398.5443478; 398.5447393; 398.5466611; 398.5441941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 17.22498246],
  battSoc=[0.9632890904; 0.9632890904; 0.9632890904; 0.9632890904; 0.9632890904; 0.9632890904; 0.9632890904; 0.9632890904; 0.9632890904; 0.9632890904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 0.8635390463],
  battCurr=[1.074735427; 1.067305336; 1.071653374; 1.075760284; 1.080125186; 1.07154345; 1.061492013; 1.068220201; 1.017316751; 1.045823471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 -0.169355389],
  axleTorq=[158; 158; 158; 158; 158; 158; 158; 158; 158; 158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 0],
  grade=[-0.0007975328; -0.0007804278; -0.0007933758; -0.0007604509; -0.0007999138; -0.0007762518; -0.0008015018; -0.0007976208; -0.0007906628; -0.0007897078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 -0.001003661],
  brakeTorq=[170; 170; 170; 170; 170; 170; 170; 170; 170; 170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 594],
  spare3=repmat(0, 48400, 1),
  spare4=repmat(0, 48400, 1),
  spare5=repmat(0, 48400, 1),
  spare6=repmat(0, 48400, 1)), struct(
  Name="Bolt 61910022 Test Data_ACM_Testing_RAW.csv",
  time=[0.099980831; 0.199980736; 0.29998064; 0.399980545; 0.49998045; 0.599980354; 0.699980259; 0.799980164; 0.899980068; 0.999979973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 10283.79017],
  accelPedalCmd=[0; 0; 0; 0; 0; 0; 0; 0; 0; 0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 0],
  brakePedalCmd=[0.17647065; 0.17647065; 0.17647065; 0.17647065; 0.17647065; 0.17647065; 0.17647065; 0.17647065; 0.17647065; 0.17647065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 0.17647065],
  accelPedalDBW=repmat(0, 102838, 1),
  brakePedalDBW=repmat(0, 102838, 1),
  vehSpd=[0.00054544959744; 0.00032231271072; 0.0002238969; 0.00044895914272; 0.000576353; 0.0003861777; 0.00054176419968; 0.0006176707; 0.0006927756528; 0.00036859744416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 0.00097159852416],
  battVolt=[385.9657231; 385.9622957; 385.9640384; 385.9627804; 385.9634804; 385.9623388; 385.9611262; 385.9615987; 385.9620508; 385.9621085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 330.1817827],
  battSoc=[0.8634322312; 0.8634322312; 0.8634322312; 0.8634322312; 0.8634322312; 0.8634322312; 0.8634322312; 0.8634322312; 0.8634322312; 0.8634322312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 0.1271710062],
  battCurr=[1.409415864; 1.407594198; 1.403300233; 1.413126898; 1.413557667; 1.403943149; 1.393855978; 1.380561909; 1.395726294; 1.402308142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 0.869071495],
  axleTorq=[118; 118; 118; 118; 118; 118; 118; 118; 118; 118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 6],
  grade=[-0.001038744; -0.001048737; -0.00103529; -0.001078412; -0.001039515; -0.001045425; -0.001048284; -0.001047756; -0.001046728; -0.001056667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 -0.001076284],
  brakeTorq=[212; 212; 212; 212; 212; 212; 212; 212; 212; 212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 504],
  spare3=repmat(0, 102838, 1),
  spare4=repmat(0, 102838, 1),
  spare5=repmat(0, 102838, 1),
  spare6=repmat(0, 102838, 1)), struct(
  Name="Bolt 61910023 Test Data_ACM_Testing_RAW.csv",
  time=[0.099980831; 0.199980736; 0.29998064; 0.399980545; 0.49998045; 0.599980354; 0.699980259; 0.799980164; 0.899980068; 0.999979973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 5347.994881],
  accelPedalCmd=[0; 0; 0; 0; 0; 0; 0; 0; 0; 0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 0],
  brakePedalCmd=[0.17647065; 0.17647065; 0.1757710596; 0.1732803; 0.1757404052; 0.1732756; 0.1757449844; 0.17254908; 0.1732114072; 0.17647065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 0],
  accelPedalDBW=repmat(0, 53480, 1),
  brakePedalDBW=repmat(0, 53480, 1),
  vehSpd=[0.00094379889472; 0.0008904934; 0.0009651115; 0.00071449106784; 0.00077653664352; 0.00076072036832; 0.00093851398784; 0.000869301; 0.00069470775968; 0.000895856984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 6.850709184e-5],
  battVolt=[330.286259; 330.2836056; 330.2860016; 330.2865797; 330.2843465; 330.2851555; 330.2854153; 330.2867106; 330.2856857; 330.2854153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 279.8295605],
  battSoc=[0.1270489318; 0.1270489318; 0.1270489318; 0.1270489318; 0.1270489318; 0.1270489318; 0.1270489318; 0.1270489318; 0.1270489318; 0.1270489318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 0],
  battCurr=[1.681424682; 1.680897845; 1.674528941; 1.645058503; 1.654170729; 1.657722109; 1.656157079; 1.660422655; 1.667475316; 1.669848076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 1.018980834],
  axleTorq=[120; 120; 120; 120; 120; 120; 120; 120; 120; 120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 0],
  grade=[-0.001024124; -0.00101192; -0.001015393; -0.0009933137; -0.0010187; -0.001031571; -0.001014409; -0.001007876; -0.0009918077; -0.0009937307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 -0.001019043],
  brakeTorq=[210; 210; 210; 210; 210; 210; 210; 210; 210; 210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 0],
  spare3=repmat(0, 53480, 1),
  spare4=repmat(0, 53480, 1),
  spare5=repmat(0, 53480, 1),
  spare6=repmat(0, 53480, 1)), struct(
  Name="Bolt 61911001 Test Data_ACM_Testing_RAW.csv",
  time=[0.099980831; 0.199980736; 0.29998064; 0.399980545; 0.49998045; 0.599980354; 0.699980259; 0.799980164; 0.899980068; 0.999979973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 4219.995956],
  accelPedalCmd=[0; 0; 0; 0; 0; 0; 0; 0; 0; 0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 0],
  brakePedalCmd=[0.1741663269; 0.1744712182; 0.17647065; 0.1741831681; 0.1744527; 0.17647065; 0.17647065; 0.17647065; 0.1745714151; 0.174468028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 0.17647065],
  accelPedalDBW=repmat(0, 42200, 1),
  brakePedalDBW=repmat(0, 42200, 1),
  vehSpd=[0.0008377221; 0.0009719065; 0.0008645574784; 0.00080417265632; 0.0008670166; 0.0007230617; 0.00072712352416; 0.0008546108384; 0.00083858937184; 0.0005697927136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 0.00040624938816],
  battVolt=[398.6520272; 398.6398722; 398.6256106; 398.6261498; 398.6257769; 398.6264002; 398.6300316; 398.6321538; 398.6477853; 398.6505484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 12.46751632],
  battSoc=[0.963929981; 0.963929981; 0.963929981; 0.963929981; 0.963929981; 0.963929981; 0.963929981; 0.963929981; 0.963929981; 0.963929981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 0.8743884086],
  battCurr=[1.273179992; 1.271870405; 1.271346469; 1.274689195; 1.274770829; 1.253955328; 1.263626048; 1.270845417; 1.265675999; 1.268358778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 -0.161569077],
  axleTorq=[238; 238; 238; 238; 238; 238; 238; 238; 238; 238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 0],
  grade=[-0.0009234537; -0.0009393857; -0.0009457647; -0.0009214117; -0.0009307307; -0.0009287437; -0.0009291887; -0.0009091977; -0.0009254647; -0.0009509067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 -0.001333607],
  brakeTorq=[102; 102; 102; 102; 102; 102; 102; 102; 102; 102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 452],
  spare3=repmat(0, 42200, 1),
  spare4=repmat(0, 42200, 1),
  spare5=repmat(0, 42200, 1),
  spare6=repmat(0, 42200, 1)), struct(
  Name="Bolt 61911002 Test Data_ACM_Testing_RAW.csv",
  time=[0.099980831; 0.199980736; 0.29998064; 0.399980545; 0.49998045; 0.599980354; 0.699980259; 0.799980164; 0.899980068; 0.999979973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 2380.99771],
  accelPedalCmd=[0; 0; 0; 0; 0; 0; 0; 0; 0; 0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 0],
  brakePedalCmd=[0.17647065; 0.17647065; 0.17647065; 0.17647065; 0.17647065; 0.17647065; 0.17647065; 0.17647065; 0.17647065; 0.17647065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 0.17647065],
  accelPedalDBW=repmat(0, 23810, 1),
  brakePedalDBW=repmat(0, 23810, 1),
  vehSpd=[0.00016016504416; 4.504777376e-5; 0.00010788282208; 3.8602619264e-5; 0.00010789668032; 0.00010778402624; 3.1837875872e-5; 1.5266103072e-5; 3.8470742464e-5; 2.063626048e-5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 0.0002138385],
  battVolt=[387.5668571; 387.5637012; 387.5650295; 387.5648629; 387.5640807; 387.5649122; 387.5644686; 387.5633769; 387.5638141; 387.5626708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 13.39908952],
  battSoc=[0.8733812948; 0.8733812948; 0.8733812948; 0.8733812948; 0.8733812948; 0.8733812948; 0.8733812948; 0.8733812948; 0.8733812948; 0.8733812948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 0.8351567483],
  battCurr=[1.255580262; 1.262064025; 1.236026381; 1.254809166; 1.254376865; 1.252970517; 1.253721804; 1.252816164; 1.262720877; 1.256350437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 -0.162904005],
  axleTorq=[220; 220; 220; 220; 220; 220; 220; 220; 220; 220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 0],
  grade=[-0.001311697; -0.001317597; -0.001318517; -0.001334045; -0.001321642; -0.001319568; -0.001334761; -0.001322485; -0.001329154; -0.001330682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 -0.001586382],
  brakeTorq=[114; 114; 114; 114; 114; 114; 114; 114; 114; 114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 460],
  spare3=repmat(0, 23810, 1),
  spare4=repmat(0, 23810, 1),
  spare5=repmat(0, 23810, 1),
  spare6=repmat(0, 23810, 1)), struct(
  Name="Bolt 61911003 Test Data_ACM_Testing_RAW.csv",
  time=[0.099980831; 0.199980736; 0.29998064; 0.399980545; 0.49998045; 0.599980354; 0.699980259; 0.799980164; 0.899980068; 0.999979973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 1161.998873],
  accelPedalCmd=[0; 0; 0; 0; 0; 0; 0; 0; 0; 0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 0],
  brakePedalCmd=[0.17647065; 0.17647065; 0.17647065; 0.17647065; 0.17647065; 0.17647065; 0.17647065; 0.17647065; 0.17647065; 0.17647065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 0.14901966],
  accelPedalDBW=repmat(0, 11620, 1),
  brakePedalDBW=repmat(0, 11620, 1),
  vehSpd=[0.00021147808352; 0.00038803429632; 0.0003173738128; 0.0004988484; 0.0002562867; 0.00035856139616; 0.00039895458944; 0.0003479268; 0.0004443417; 0.00047894256256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 0.000247104],
  battVolt=[383.0768364; 383.0769527; 383.0806273; 383.0778142; 383.0764424; 383.0782405; 383.0776612; 383.0771472; 383.0770853; 383.0770853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 375.4940512],
  battSoc=[0.8341801531; 0.8341801531; 0.8341801531; 0.8341801531; 0.8341801531; 0.8341801531; 0.8341801531; 0.8341801531; 0.8341801531; 0.8341801531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 0.7798723044],
  battCurr=[1.802176877; 1.799705253; 1.797693391; 1.795059503; 1.80634605; 1.811473037; 1.808227483; 1.808856327; 1.801243342; 1.795707263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 0.781761009],
  axleTorq=[202; 202; 202; 202; 202; 202; 202; 202; 202; 202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 14],
  grade=[-0.001566409; -0.001566753; -0.001583255; -0.001568554; -0.001567502; -0.001539447; -0.001546893; -0.001565001; -0.001583845; -0.00155662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 -0.001172241],
  brakeTorq=[130; 130; 130; 130; 130; 130; 130; 130; 130; 130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 394],
  spare3=repmat(0, 11620, 1),
  spare4=repmat(0, 11620, 1),
  spare5=repmat(0, 11620, 1),
  spare6=repmat(0, 11620, 1)), struct(
  Name="Bolt 61911004 Test Data_ACM_Testing_RAW.csv",
  time=[0.099980831; 0.199980736; 0.29998064; 0.399980545; 0.49998045; 0.599980354; 0.699980259; 0.799980164; 0.899980068; 0.999979973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 2717.19739],
  accelPedalCmd=[0; 0; 0; 0; 0; 0; 0; 0; 0; 0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 0],
  brakePedalCmd=[0.17647065; 0.17647065; 0.17647065; 0.17647065; 0.17647065; 0.17647065; 0.17647065; 0.17647065; 0.17647065; 0.17647065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 0.17647065],
  accelPedalDBW=repmat(0, 27172, 1),
  brakePedalDBW=repmat(0, 27172, 1),
  vehSpd=[0.0004392874; 0.00060159871552; 0.0006165647; 0.0007948595; 0.000680070776; 0.0008203345; 0.0005096095; 0.000500459; 0.00062478578624; 0.00056524765792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 0.0002760839],
  battVolt=[377.4567355; 377.4754385; 377.4604085; 377.4568603; 377.454926; 377.4526; 377.4544782; 377.4539425; 377.4657979; 377.4532879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 362.7561706],
  battSoc=[0.7813525; 0.7813525; 0.7813525; 0.7813525; 0.7813525; 0.7813525; 0.7813525; 0.7813525; 0.7813525; 0.7813495029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 0.6620705],
  battCurr=[2.253959047; 2.254294187; 2.244895016; 2.252037554; 2.245424987; 2.249358784; 2.256475754; 2.253290034; 2.253542279; 2.254019658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 0.782407753],
  axleTorq=[298; 298; 298; 298; 298; 298; 298; 298; 298; 298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 6],
  grade=[-0.0009078778; -0.0009310097; -0.0009209937; -0.0009234447; -0.0009160417; -0.0008972658; -0.0009099187; -0.0009174317; -0.0009269317; -0.0008954668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 -0.001024415],
  brakeTorq=[60; 60; 60; 60; 60; 60; 60; 60; 60; 60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 658],
  spare3=repmat(0, 27172, 1),
  spare4=repmat(0, 27172, 1),
  spare5=repmat(0, 27172, 1),
  spare6=repmat(0, 27172, 1)), struct(
  Name="Bolt 61911005 Test Data_ACM_Testing_RAW.csv",
  time=[0.099980831; 0.199980736; 0.29998064; 0.399980545; 0.49998045; 0.599980354; 0.699980259; 0.799980164; 0.899980068; 0.999979973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 867.9991531],
  accelPedalCmd=[0; 0; 0; 0; 0; 0; 0; 0; 0; 0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 0],
  brakePedalCmd=[0.17254908; 0.17254908; 0.17254908; 0.17254908; 0.17254908; 0.17254908; 0.17254908; 0.17254908; 0.17254908; 0.17254908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 0.17647065],
  accelPedalDBW=repmat(0, 8680, 1),
  brakePedalDBW=repmat(0, 8680, 1),
  vehSpd=[1.5266103072e-5; 1.5266103072e-5; 1.5266103072e-5; 1.5266103072e-5; 1.5266103072e-5; 5.873837e-05; 2.926346e-05; 1.5266103072e-5; 1.5266103072e-5; 1.5266103072e-5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 0.00064700680352],
  battVolt=[365.09367; 365.094496; 365.0943769; 365.0988125; 365.0965189; 365.0958604; 365.0958604; 365.093946; 365.0932133; 365.0966337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 20.70083639],
  battSoc=[0.6618263596; 0.6618263596; 0.6618263596; 0.6618263596; 0.6618263596; 0.6618263596; 0.6618263596; 0.6618263596; 0.6618263596; 0.6618263596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 0.6313077596],
  battCurr=[2.020910615; 2.021883517; 2.013975587; 2.011924014; 2.016701838; 2.003450095; 2.016388733; 2.013249924; 2.018498167; 2.012022279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 -0.161038781],
  axleTorq=[180; 180; 180; 180; 180; 180; 180; 180; 180; 180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 0],
  grade=[-0.00107008; -0.001064241; -0.001052583; -0.001035036; -0.001052951; -0.001038354; -0.001035817; -0.001025769; -0.001015095; -0.001039654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 -0.0009010338],
  brakeTorq=[150; 150; 150; 150; 150; 150; 150; 150; 150; 150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 512],
  spare3=repmat(0, 8680, 1),
  spare4=repmat(0, 8680, 1),
  spare5=repmat(0, 8680, 1),
  spare6=repmat(0, 8680, 1)), struct(
  Name="Bolt 61911006 Test Data_ACM_Testing_RAW.csv",
  time=[0.099980831; 0.199980736; 0.29998064; 0.399980545; 0.49998045; 0.599980354; 0.699980259; 0.799980164; 0.899980068; 0.999979973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 627.999382],
  accelPedalCmd=repmat(0, 6280, 1),
  brakePedalCmd=repmat(0, 6280, 1),
  accelPedalDBW=repmat(0, 6280, 1),
  brakePedalDBW=repmat(0, 6280, 1),
  vehSpd=[4.4245873408e-5; 2.15372696e-5; 1.5266103072e-5; 8.258214624e-5; 3.3959348896e-5; 0.00019405514656; 0.00018040835648; 4.666963e-05; 1.5266103072e-5; 1.5266103072e-5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 1.5266103072e-5],
  battVolt=[362.6670904; 362.6648833; 362.6667255; 362.6660158; 362.6638265; 362.6634059; 362.6646922; 362.66528; 362.6640719; 362.66284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 11.66714034],
  battSoc=repmat(0, 6280, 1),
  battCurr=[1.998335307; 1.998435211; 1.999405077; 1.999845415; 1.999109026; 1.999736461; 1.992937974; 1.994710901; 1.988739248; 1.961855962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 -0.163462856],
  axleTorq=repmat(0, 6280, 1),
  grade=[-0.001087907; -0.001058662; -0.001076653; -0.001086073; -0.001068336; -0.001051317; -0.001053725; -0.001088039; -0.001055569; -0.001074438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 -0.001170378],
  brakeTorq=repmat(0, 6280, 1),
  spare3=repmat(0, 6280, 1),
  spare4=repmat(0, 6280, 1),
  spare5=repmat(0, 6280, 1),
  spare6=repmat(0, 6280, 1)), struct(
  Name="Bolt 61911007 Test Data_ACM_Testing_RAW.csv",
  time=[0.099980831; 0.199980736; 0.29998064; 0.399980545; 0.49998045; 0.599980354; 0.699980259; 0.799980164; 0.899980068; 0.999979973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 1822.998242],
  accelPedalCmd=repmat(0, 18230, 1),
  brakePedalCmd=repmat(0, 18230, 1),
  accelPedalDBW=repmat(0, 18230, 1),
  brakePedalDBW=repmat(0, 18230, 1),
  vehSpd=[0.0007233710704; 0.00075552799872; 0.00065659178816; 0.0003963166064; 0.00035642633312; 0.00070013080192; 0.000683948848; 0.00065282100576; 0.00044787685888; 0.0005039732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 0.0005910517008],
  battVolt=[398.1263274; 398.1176947; 398.1049525; 398.112302; 398.1052838; 398.1028193; 398.1016583; 398.1057988; 398.102923; 398.1042506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 13.1885488],
  battSoc=repmat(0, 18230, 1),
  battCurr=[1.270384389; 1.263967232; 1.267639073; 1.269814192; 1.267013469; 1.259856345; 1.268935968; 1.272081502; 1.262474971; 1.271991611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 -0.161560269],
  axleTorq=repmat(0, 18230, 1),
  grade=[-0.0008251178; -0.0008058798; -0.0008048068; -0.0008126738; -0.0008233598; -0.0008079158; -0.0008148928; -0.0007990118; -0.0008221288; -0.0008379228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 -0.001386389],
  brakeTorq=repmat(0, 18230, 1),
  spare3=repmat(0, 18230, 1),
  spare4=repmat(0, 18230, 1),
  spare5=repmat(0, 18230, 1),
  spare6=repmat(0, 18230, 1)), struct(
  Name="Bolt 61911008 Test Data_ACM_Testing_RAW.csv",
  time=[0.099980831; 0.199980736; 0.29998064; 0.399980545; 0.49998045; 0.599980354; 0.699980259; 0.799980164; 0.899980068; 0.999979973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 1598.698456],
  accelPedalCmd=repmat(0, 15987, 1),
  brakePedalCmd=repmat(0, 15987, 1),
  accelPedalDBW=repmat(0, 15987, 1),
  brakePedalDBW=repmat(0, 15987, 1),
  vehSpd=[0.04580919; 0.04583879; 0.03734139; 0.04349705; 0.04562415; 0.04587438; 0.04564661; 0.04585123; 0.04584987; 0.03724812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 0.00033404348736],
  battVolt=[389.4606103; 389.4725349; 389.471782; 389.4734149; 389.4758651; 389.4731572; 389.4743087; 389.4737962; 389.47263; 389.4733664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 15.06673908],
  battSoc=repmat(0, 15987, 1),
  battCurr=[1.619070544; 1.595157842; 1.60007863; 1.606988208; 1.647904501; 1.598438266; 1.603306685; 1.598386612; 1.626840777; 1.593343506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 -0.181564695],
  axleTorq=repmat(0, 15987, 1),
  grade=[-0.0009457597; -0.00103268; -0.001094874; -0.001037211; -0.0008830668; -0.00102069; -0.001102502; -0.001266732; -0.001288993; -0.0009676647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 -0.001239671],
  brakeTorq=repmat(0, 15987, 1),
  spare3=repmat(0, 15987, 1),
  spare4=repmat(0, 15987, 1),
  spare5=repmat(0, 15987, 1),
  spare6=repmat(0, 15987, 1)), struct(
  Name="Bolt 61911009 Test Data_ACM_Testing_RAW.csv",
  time=[0.099980831; 0.199980736; 0.29998064; 0.399980545; 0.49998045; 0.599980354; 0.699980259; 0.799980164; 0.899980068; 0.999979973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 833.3991861],
  accelPedalCmd=repmat(0, 8334, 1),
  brakePedalCmd=repmat(0, 8334, 1),
  accelPedalDBW=repmat(0, 8334, 1),
  brakePedalDBW=repmat(0, 8334, 1),
  vehSpd=[0.1217032; 0.4293229; 0.8596503; 1.29375; 1.678904; 2.042253; 2.420736; 2.810883; 3.205058; 3.586827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 0.0003630233024],
  battVolt=[379.9939003; 379.9716638; 379.1267872; 377.3031032; 375.6654139; 374.6329744; 373.6251432; 373.2514665; 373.1824916; 372.9070608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 379.5217495],
  battSoc=repmat(0, 8334, 1),
  battCurr=[2.567938068; 3.015816027; 19.72439398; 55.21234929; 86.10393502; 105.3215423; 123.7429924; 129.3940403; 129.2126749; 133.1938863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 0.805367177],
  axleTorq=repmat(0, 8334, 1),
  grade=[-0.00116086; -0.001176703; -0.001203452; -0.001142356; -0.001156902; -0.001126948; -0.001151836; -0.00118411; -0.001183395; -0.001171409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 -0.001004965],
  brakeTorq=repmat(0, 8334, 1),
  spare3=repmat(0, 8334, 1),
  spare4=repmat(0, 8334, 1),
  spare5=repmat(0, 8334, 1),
  spare6=repmat(0, 8334, 1)), struct(
  Name="Bolt_15-APP_Request_to_DBW_System_10ms.mat",
  time=[0; 0.01000003; 0.02000014; 0.03000017; 0.04000028; 0.05000031; 0.06000038; 0.0700005; 0.08000053; 0.09000064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 41.42026],
  accelPedalCmd=[0; 0; 0; 0; 0; 0; 0; 0; 0; 0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 0.15],
  brakePedalCmd=[0.2; 0.2; 0.2; 0.2; 0.2; 0.2; 0.2; 0.2; 0.2; 0.2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 0],
  accelPedalDBW=[0; 0; 0; 0; 0; 0; 0; 0; 0; 0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 0.145],
  brakePedalDBW=[0.22; 0.22; 0.22; 0.22; 0.22; 0.22; 0.22; 0.22; 0.22; 0.22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 0],
  vehSpd=[0; 0; 0; 0; 0; 0; 0; 0; 0; 0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 10.27778],
  battVolt=repmat(0, 4143, 1),
  battSoc=repmat(0, 4143, 1),
  battCurr=[0.6681536; 0.5997479; 0.3642697; 0.4373502; 0.362778; 0.4382526; 0.7090766; 0.6380567; 0.4892349; 0.4805587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 16.84146],
  axleTorq=[6; 6; 6; 6; 6; 6; 6; 6; 6; 6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 156],
  grade=repmat(0, 4143, 1),
  brakeTorq=repmat(0, 4143, 1),
  spare3=repmat(0, 4143, 1),
  spare4=repmat(0, 4143, 1),
  spare5=repmat(0, 4143, 1),
  spare6=repmat(0, 4143, 1)), struct(
  Name="Bolt_15-BPP_Request_to_DBW_System_10ms.mat",
  time=[0; 0.01000008; 0.02000017; 0.03000025; 0.04000033; 0.05000042; 0.0600005; 0.07000059; 0.08000067; 0.09000075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 12.46009],
  accelPedalCmd=repmat(0, 1247, 1),
  brakePedalCmd=repmat(0.15, 1247, 1),
  accelPedalDBW=repmat(0, 1247, 1),
  brakePedalDBW=[0; 0.083; 0.083; 0.149; 0.149; 0.141; 0.141; 0.15; 0.15; 0.192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 0.003],
  vehSpd=[14.63542; 14.63542; 14.63542; 14.63542; 14.61806; 14.61806; 14.61806; 14.61806; 14.61806; 14.53993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 0.2170139],
  battVolt=repmat(0, 1247, 1),
  battSoc=repmat(0, 1247, 1),
  battCurr=[-31.52964; -30.04856; -31.67075; -31.2475; -37.65082; -37.23685; -32.84229; -33.46209; -32.64609; -35.58699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 2.025426],
  axleTorq=[-246; -246; -264; -306; -324; -324; -344; -364; -404; -424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 338],
  grade=repmat(0, 1247, 1),
  brakeTorq=repmat(0, 1247, 1),
  spare3=repmat(0, 1247, 1),
  spare4=repmat(0, 1247, 1),
  spare5=repmat(0, 1247, 1),
  spare6=repmat(0, 1247, 1)), struct(
  Name="Bolt_20-APP_Request_to_DBW_System_10ms.mat",
  time=[0; 0.0100001; 0.02000013; 0.03000023; 0.04000025; 0.05000035; 0.06000038; 0.07000048; 0.0800005; 0.09000061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 41.42027],
  accelPedalCmd=[0; 0; 0; 0; 0; 0; 0; 0; 0; 0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 0.2],
  brakePedalCmd=[0.2; 0.2; 0.2; 0.2; 0.2; 0.2; 0.2; 0.2; 0.2; 0.2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 0],
  accelPedalDBW=[0; 0; 0; 0; 0; 0; 0; 0; 0; 0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 0.192],
  brakePedalDBW=[0.19; 0.19; 0.19; 0.19; 0.19; 0.19; 0.19; 0.19; 0.191; 0.191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 0],
  vehSpd=[0; 0; 0; 0; 0; 0; 0; 0; 0; 0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 16.15451],
  battVolt=repmat(0, 4143, 1),
  battSoc=repmat(0, 4143, 1),
  battCurr=[0.4645685; 0.5808922; 0.6665066; 0.5357819; 0.5840547; 0.6088185; 0.4815329; 0.5010699; 0.4972007; 0.4381133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 35.20092],
  axleTorq=[6; 6; 6; 6; 6; 6; 6; 6; 6; 6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 220],
  grade=repmat(0, 4143, 1),
  brakeTorq=repmat(0, 4143, 1),
  spare3=repmat(0, 4143, 1),
  spare4=repmat(0, 4143, 1),
  spare5=repmat(0, 4143, 1),
  spare6=repmat(0, 4143, 1)), struct(
  Name="Bolt_20-BPP_Request_to_DBW_System_10ms.mat",
  time=[0; 0.01000008; 0.02000016; 0.03000028; 0.04000036; 0.05000044; 0.06000052; 0.0700006; 0.08000068; 0.09000076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 10.25007],
  accelPedalCmd=repmat(0, 1026, 1),
  brakePedalCmd=repmat(0.2, 1026, 1),
  accelPedalDBW=[0; 0; 0; 0; 0; 0; 0; 0; 0; 0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 0.055],
  brakePedalDBW=[0; 0.123; 0.123; 0.2; 0.2; 0.193; 0.193; 0.195; 0.195; 0.229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 0.005],
  vehSpd=[14.0625; 14.0625; 14.0625; 13.99306; 13.99306; 13.99306; 13.99306; 13.99306; 13.91493; 13.91493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 0.2777778],
  battVolt=repmat(0, 1026, 1),
  battSoc=repmat(0, 1026, 1),
  battCurr=[-26.28464; -26.67157; -25.82889; -32.71377; -35.37738; -33.46131; -31.30694; -33.4205; -34.89451; -33.77143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 6.781755],
  axleTorq=[-248; -248; -248; -286; -308; -326; -346; -346; -388; -406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 442],
  grade=repmat(0, 1026, 1),
  brakeTorq=repmat(0, 1026, 1),
  spare3=repmat(0, 1026, 1),
  spare4=repmat(0, 1026, 1),
  spare5=repmat(0, 1026, 1),
  spare6=repmat(0, 1026, 1)), struct(
  Name="Bolt_30-APP_Request_to_DBW_System_10ms.mat",
  time=[0; 0.01000005; 0.02000011; 0.03000016; 0.04000021; 0.0500003; 0.06000036; 0.07000041; 0.08000046; 0.09000051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 41.42023],
  accelPedalCmd=[0; 0; 0; 0; 0; 0; 0; 0; 0; 0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 0.3],
  brakePedalCmd=[0.2; 0.2; 0.2; 0.2; 0.2; 0.2; 0.2; 0.2; 0.2; 0.2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 0],
  accelPedalDBW=[0; 0; 0; 0; 0; 0; 0; 0; 0; 0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 0.295],
  brakePedalDBW=[0.237; 0.237; 0.237; 0.237; 0.237; 0.237; 0.237; 0.237; 0.237; 0.237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 0],
  vehSpd=[0; 0; 0; 0; 0; 0; 0; 0; 0; 0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 26.15451],
  battVolt=repmat(0, 4143, 1),
  battSoc=repmat(0, 4143, 1),
  battCurr=[0.3119529; 0.4143292; 0.4911545; 0.6243627; 0.4315533; 0.29857; 0.1890456; 0.4500735; 0.5800472; 0.6524839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 88.30288],
  axleTorq=[6; 6; 6; 6; 6; 6; 6; 6; 6; 6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 340],
  grade=repmat(0, 4143, 1),
  brakeTorq=repmat(0, 4143, 1),
  spare3=repmat(0, 4143, 1),
  spare4=repmat(0, 4143, 1),
  spare5=repmat(0, 4143, 1),
  spare6=repmat(0, 4143, 1)), struct(
  Name="Bolt_30-BPP_Request_to_DBW_System_10ms.mat",
  time=[0; 0.01000007; 0.02000014; 0.03000021; 0.04000028; 0.05000035; 0.06000041; 0.07000048; 0.08000055; 0.09000062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 7.280054],
  accelPedalCmd=repmat(0, 729, 1),
  brakePedalCmd=repmat(0.3, 729, 1),
  accelPedalDBW=repmat(0, 729, 1),
  brakePedalDBW=[0; 0.081; 0.081; 0.183; 0.183; 0.274; 0.274; 0.294; 0.294; 0.295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 0.003],
  vehSpd=[14.7309; 14.7309; 14.67014; 14.67014; 14.67014; 14.67014; 14.67014; 14.65278; 14.65278; 14.65278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 0],
  battVolt=repmat(0, 729, 1),
  battSoc=repmat(0, 729, 1),
  battCurr=[-30.51351; -29.88872; -30.44203; -34.54434; -33.04337; -35.49552; -33.11595; -33.46005; -35.39102; -31.3445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 3.244612],
  axleTorq=[-246; -246; -284; -284; -306; -324; -344; -386; -386; -404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 384],
  grade=repmat(0, 729, 1),
  brakeTorq=repmat(0, 729, 1),
  spare3=repmat(0, 729, 1),
  spare4=repmat(0, 729, 1),
  spare5=repmat(0, 729, 1),
  spare6=repmat(0, 729, 1)), struct(
  Name="Bolt_15-APP_Request_to_DBW_System_50ms.mat",
  time=[0; 0.05000031; 0.1000007; 0.1500011; 0.2000013; 0.2500017; 0.300002; 0.3500023; 0.4000027; 0.450003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 44.30028],
  accelPedalCmd=[0; 0; 0; 0; 0; 0; 0; 0; 0; 0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 0.15],
  brakePedalCmd=[0.2; 0.2; 0.2; 0.2; 0.2; 0.2; 0.2; 0.2; 0.2; 0.2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 0],
  accelPedalDBW=[0; 0; 0; 0; 0; 0; 0; 0; 0; 0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 0.145],
  brakePedalDBW=[0.22; 0.22; 0.22; 0.22; 0.22; 0.22; 0.22; 0.22; 0.22; 0.22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 0],
  vehSpd=[0; 0; 0; 0; 0; 0; 0; 0; 0; 0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 10.68576],
  battVolt=repmat(0, 887, 1),
  battSoc=repmat(0, 887, 1),
  battCurr=[0.6681536; 0.4382526; 0.3154005; 0.6128075; 0.4856673; 0.4022515; 0.4999144; 0.5271374; 0.5783597; 0.3289056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 14.6972],
  axleTorq=[6; 6; 6; 6; 6; 6; 6; 6; 6; 6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 152],
  grade=repmat(0, 887, 1),
  brakeTorq=repmat(0, 887, 1),
  spare3=repmat(0, 887, 1),
  spare4=repmat(0, 887, 1),
  spare5=repmat(0, 887, 1),
  spare6=repmat(0, 887, 1)), struct(
  Name="Bolt_15-BPP_Request_to_DBW_System_50ms.mat",
  time=[0; 0.05000042; 0.1000008; 0.1500012; 0.2000016; 0.2500021; 0.3000025; 0.3500029; 0.4000033; 0.4500037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 12.45009],
  accelPedalCmd=repmat(0, 250, 1),
  brakePedalCmd=repmat(0.15, 250, 1),
  accelPedalDBW=repmat(0, 250, 1),
  brakePedalDBW=[0; 0.141; 0.192; 0.176; 0.151; 0.142; 0.144; 0.143; 0.143; 0.143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 0.003],
  vehSpd=[14.63542; 14.61806; 14.53993; 14.38368; 14.32292; 14.24479; 14.21875; 14.07118; 13.99306; 13.90625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 0.2170139],
  battVolt=repmat(0, 250, 1),
  battSoc=repmat(0, 250, 1),
  battCurr=[-31.52964; -37.23685; -36.52661; -67.68775; -71.07627; -70.08743; -87.59926; -94.94269; -102.9003; -99.38123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 1.605856],
  axleTorq=[-246; -324; -424; -526; -626; -724; -826; -856; -856; -856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 340],
  grade=repmat(0, 250, 1),
  brakeTorq=repmat(0, 250, 1),
  spare3=repmat(0, 250, 1),
  spare4=repmat(0, 250, 1),
  spare5=repmat(0, 250, 1),
  spare6=repmat(0, 250, 1)), struct(
  Name="Bolt_20-APP_Request_to_DBW_System_50ms.mat",
  time=[0; 0.05000035; 0.1000006; 0.150001; 0.2000013; 0.2500016; 0.3000019; 0.3500022; 0.4000026; 0.4500028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 34.55023],
  accelPedalCmd=[0; 0; 0; 0; 0; 0; 0; 0; 0; 0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 0.2],
  brakePedalCmd=[0.2; 0.2; 0.2; 0.2; 0.2; 0.2; 0.2; 0.2; 0.2; 0.2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 0],
  accelPedalDBW=[0; 0; 0; 0; 0; 0; 0; 0; 0; 0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 0.192],
  brakePedalDBW=[0.19; 0.19; 0.19; 0.19; 0.19; 0.19; 0.19; 0.19; 0.19; 0.19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 0],
  vehSpd=[0; 0; 0; 0; 0; 0; 0; 0; 0; 0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 14.46181],
  battVolt=repmat(0, 692, 1),
  battSoc=repmat(0, 692, 1),
  battCurr=[0.4645685; 0.6088185; 0.4336793; 0.4542611; 0.5086409; 0.4959861; 0.5594367; 0.4560498; 0.5048298; 0.6474472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 37.37205],
  axleTorq=[6; 6; 6; 6; 6; 6; 6; 6; 6; 6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 254],
  grade=repmat(0, 692, 1),
  brakeTorq=repmat(0, 692, 1),
  spare3=repmat(0, 692, 1),
  spare4=repmat(0, 692, 1),
  spare5=repmat(0, 692, 1),
  spare6=repmat(0, 692, 1)), struct(
  Name="Bolt_20-BPP_Request_to_DBW_System_50ms.mat",
  time=[0; 0.05000044; 0.1000008; 0.1500012; 0.2000016; 0.250002; 0.3000024; 0.3500028; 0.4000032; 0.4500036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 10.25007],
  accelPedalCmd=repmat(0, 206, 1),
  brakePedalCmd=repmat(0.2, 206, 1),
  accelPedalDBW=[0; 0; 0; 0; 0; 0; 0; 0; 0; 0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 0.055],
  brakePedalDBW=[0; 0.193; 0.229; 0.234; 0.208; 0.194; 0.194; 0.196; 0.194; 0.194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 0.005],
  vehSpd=[14.0625; 13.99306; 13.91493; 13.71528; 13.68056; 13.49826; 13.40278; 13.26389; 13.15104; 13.02951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 0.2777778],
  battVolt=repmat(0, 206, 1),
  battSoc=repmat(0, 206, 1),
  battCurr=[-26.28464; -33.46131; -37.38494; -64.22676; -65.0325; -68.74778; -79.66122; -87.31716; -92.08846; -95.89819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 6.781755],
  axleTorq=[-248; -326; -426; -528; -628; -726; -826; -858; -858; -858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 442],
  grade=repmat(0, 206, 1),
  brakeTorq=repmat(0, 206, 1),
  spare3=repmat(0, 206, 1),
  spare4=repmat(0, 206, 1),
  spare5=repmat(0, 206, 1),
  spare6=repmat(0, 206, 1)), struct(
  Name="Bolt_30-APP_Request_to_DBW_System_50ms.mat",
  time=[0; 0.0500003; 0.1000006; 0.1500008; 0.2000011; 0.2500013; 0.3000016; 0.3500019; 0.4000021; 0.4500024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 41.40023],
  accelPedalCmd=[0; 0; 0; 0; 0; 0; 0; 0; 0; 0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 0.3],
  brakePedalCmd=[0.2; 0.2; 0.2; 0.2; 0.2; 0.2; 0.2; 0.2; 0.2; 0.2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 0],
  accelPedalDBW=[0; 0; 0; 0; 0; 0; 0; 0; 0; 0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 0.295],
  brakePedalDBW=[0.237; 0.237; 0.237; 0.237; 0.237; 0.237; 0.237; 0.237; 0.237; 0.237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 0],
  vehSpd=[0; 0; 0; 0; 0; 0; 0; 0; 0; 0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 26.04167],
  battVolt=repmat(0, 829, 1),
  battSoc=repmat(0, 829, 1),
  battCurr=[0.3119529; 0.29857; 0.4830893; 0.4161353; 0.4142983; 0.3700838; 0.316172; 0.6660095; 0.5270826; 0.3832009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 96.09226],
  axleTorq=[6; 6; 6; 6; 6; 6; 6; 6; 6; 6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 340],
  grade=repmat(0, 829, 1),
  brakeTorq=repmat(0, 829, 1),
  spare3=repmat(0, 829, 1),
  spare4=repmat(0, 829, 1),
  spare5=repmat(0, 829, 1),
  spare6=repmat(0, 829, 1)), struct(
  Name="Bolt_30-BPP_Request_to_DBW_System_50ms.mat",
  time=[0; 0.05000035; 0.1000007; 0.1500011; 0.2000014; 0.2500017; 0.3000021; 0.3500024; 0.4000028; 0.4500032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 7.250054],
  accelPedalCmd=repmat(0, 146, 1),
  brakePedalCmd=repmat(0.3, 146, 1),
  accelPedalDBW=repmat(0, 146, 1),
  brakePedalDBW=[0; 0.274; 0.295; 0.344; 0.321; 0.294; 0.294; 0.297; 0.295; 0.294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 0.003],
  vehSpd=[14.7309; 14.67014; 14.65278; 14.51389; 14.1059; 13.984375; 13.71528; 13.57639; 13.24653; 13.10764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 0],
  battVolt=repmat(0, 146, 1),
  battSoc=repmat(0, 146, 1),
  battCurr=[-30.51351; -35.49552; -33.65115; -60.24976; -72.6836; -76.21824; -80.93296; -90.95246; -92.53988; -91.76134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 6.454858],
  axleTorq=[-246; -324; -424; -528; -628; -726; -826; -856; -858; -858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 388],
  grade=repmat(0, 146, 1),
  brakeTorq=repmat(0, 146, 1),
  spare3=repmat(0, 146, 1),
  spare4=repmat(0, 146, 1),
  spare5=repmat(0, 146, 1),
  spare6=repmat(0, 146, 1)), struct(
  Name="Bolt_10-BPP_Request_to_DBW_System_50ms.mat",
  time=[0; 0.0500003; 0.1000006; 0.1500009; 0.2000012; 0.2500015; 0.3000018; 0.3500021; 0.4000024; 0.4500027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 34.65025],
  accelPedalCmd=repmat(0, 694, 1),
  brakePedalCmd=repmat(0.1, 694, 1),
  accelPedalDBW=repmat(0, 694, 1),
  brakePedalDBW=[0; 0.114; 0.131; 0.093; 0.097; 0.1; 0.092; 0.095; 0.096; 0.096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 0.005],
  vehSpd=[14.59201; 14.609375; 14.51389; 14.46181; 14.43576; 14.34028; 14.296875; 14.24479; 14.14931; 14.14931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 0.4513889],
  battVolt=repmat(0, 694, 1),
  battSoc=repmat(0, 694, 1),
  battCurr=[-30.64489; -33.71916; -47.82191; -59.93346; -55.9153; -55.48861; -59.96187; -51.93621; -56.82497; -57.38042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 5.24039],
  axleTorq=[-246; -344; -444; -546; -438; -496; -416; -474; -482; -464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 268],
  grade=repmat(0, 694, 1),
  brakeTorq=repmat(0, 694, 1),
  spare3=repmat(0, 694, 1),
  spare4=repmat(0, 694, 1),
  spare5=repmat(0, 694, 1),
  spare6=repmat(0, 694, 1)), struct(
  Name="Bolt_2.5-BPP_Request_to_DBW_System_50ms.mat",
  time=[0; 0.05000045; 0.1000009; 0.1500013; 0.2000018; 0.2500023; 0.3000027; 0.3500032; 0.4000036; 0.4500041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 45.15033],
  accelPedalCmd=repmat(0, 904, 1),
  brakePedalCmd=repmat(0.025, 904, 1),
  accelPedalDBW=repmat(0, 904, 1),
  brakePedalDBW=[0; 0.04; 0.024; 0.027; 0.03; 0.025; 0.027; 0.027; 0.027; 0.026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 0.021],
  vehSpd=[14.921875; 14.85243; 14.86979; 14.84375; 14.765625; 14.77431; 14.71354; 14.65278; 14.63542; 14.59201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 1.258681],
  battVolt=repmat(0, 904, 1),
  battSoc=repmat(0, 904, 1),
  battCurr=[-31.85597; -33.45062; -38.3603; -39.02136; -38.95385; -40.25334; -38.77204; -36.47207; -37.54923; -38.78972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 1.791226],
  axleTorq=[-246; -324; -324; -308; -308; -308; -308; -308; -308; -308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 66],
  grade=repmat(0, 904, 1),
  brakeTorq=repmat(0, 904, 1),
  spare3=repmat(0, 904, 1),
  spare4=repmat(0, 904, 1),
  spare5=repmat(0, 904, 1),
  spare6=repmat(0, 904, 1)), struct(
  Name="Bolt_5-BPP_Request_to_DBW_System_50ms.mat",
  time=[0; 0.05000039; 0.1000007; 0.1500011; 0.2000014; 0.2500017; 0.3000021; 0.3500025; 0.4000028; 0.4500031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 46.95034],
  accelPedalCmd=repmat(0, 940, 1),
  brakePedalCmd=repmat(0.05, 940, 1),
  accelPedalDBW=repmat(0, 940, 1),
  brakePedalDBW=[0; 0.069; 0.051; 0.044; 0.05; 0.047; 0.046; 0.046; 0.046; 0.046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 0],
  vehSpd=[14.94792; 14.93056; 14.88715; 14.86979; 14.80903; 14.77431; 14.74826; 14.71354; 14.65278; 14.65278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 1.09375],
  battVolt=repmat(0, 940, 1),
  battSoc=repmat(0, 940, 1),
  battCurr=[-31.92191; -34.52315; -45.4868; -46.5212; -32.73565; -31.84783; -29.79689; -30.99853; -32.30258; -30.82768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 1.434582],
  axleTorq=[-244; -324; -424; -246; -246; -248; -246; -246; -246; -246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 98],
  grade=repmat(0, 940, 1),
  brakeTorq=repmat(0, 940, 1),
  spare3=repmat(0, 940, 1),
  spare4=repmat(0, 940, 1),
  spare5=repmat(0, 940, 1),
  spare6=repmat(0, 940, 1)), struct(
  Name="Bolt_7.5-BPP_Request_to_DBW_System_50ms.mat",
  time=[0; 0.05000035; 0.1000006; 0.150001; 0.2000013; 0.2500015; 0.3000019; 0.3500022; 0.4000025; 0.4500028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 47.25034],
  accelPedalCmd=repmat(0, 946, 1),
  brakePedalCmd=repmat(0.075, 946, 1),
  accelPedalDBW=repmat(0, 946, 1),
  brakePedalDBW=[0; 0.109; 0.102; 0.065; 0.073; 0.074; 0.071; 0.074; 0.073; 0.072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 0],
  vehSpd=[14.14931; 14.140625; 14.01042; 14.07118; 14.02778; 13.94965; 13.93229; 13.87153; 13.828125; 13.828125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 0.6857639],
  battVolt=repmat(0, 946, 1),
  battSoc=repmat(0, 946, 1),
  battCurr=[-28.37443; -34.09787; -45.39128; -46.9864; -40.84249; -32.97999; -33.91716; -34.33406; -32.76159; -33.29288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 -0.8173461],
  axleTorq=[-246; -324; -426; -326; -266; -336; -286; -286; -286; -286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 192],
  grade=repmat(0, 946, 1),
  brakeTorq=repmat(0, 946, 1),
  spare3=repmat(0, 946, 1),
  spare4=repmat(0, 946, 1),
  spare5=repmat(0, 946, 1),
  spare6=repmat(0, 946, 1))]

InitStates = [struct(VehSpd=0, AxleTorq=0, BattSoc=0.9, BattCurr=0), struct(VehSpd=0, AxleTorq=0, BattSoc=0.9, BattCurr=0), struct(VehSpd=0, AxleTorq=0, BattSoc=0.9, BattCurr=0), struct(VehSpd=0, AxleTorq=0, BattSoc=0.9, BattCurr=0), struct(VehSpd=0, AxleTorq=0, BattSoc=0.9, BattCurr=0), struct(VehSpd=0, AxleTorq=0, BattSoc=0.9, BattCurr=0), struct(VehSpd=0.00027396354656, AxleTorq=158, BattSoc=0.9632890904, BattCurr=1.074735427), struct(VehSpd=0.00054544959744, AxleTorq=118, BattSoc=0.8634322312, BattCurr=1.409415864), struct(VehSpd=0.00094379889472, AxleTorq=120, BattSoc=0.1270489318, BattCurr=1.681424682), struct(VehSpd=0.0008377221, AxleTorq=238, BattSoc=0.963929981, BattCurr=1.273179992), struct(VehSpd=0.00016016504416, AxleTorq=220, BattSoc=0.8733812948, BattCurr=1.255580262), struct(VehSpd=0.00021147808352, AxleTorq=202, BattSoc=0.8341801531, BattCurr=1.802176877), struct(VehSpd=0.0004392874, AxleTorq=298, BattSoc=0.7813525, BattCurr=2.253959047), struct(VehSpd=1.5266103072e-5, AxleTorq=180, BattSoc=0.6618263596, BattCurr=2.020910615), struct(VehSpd=4.4245873408e-5, AxleTorq=0, BattSoc=0.9, BattCurr=1.998335307), struct(VehSpd=0.0007233710704, AxleTorq=0, BattSoc=0.9, BattCurr=1.270384389), struct(VehSpd=0.04580919, AxleTorq=0, BattSoc=0.9, BattCurr=1.619070544), struct(VehSpd=0.1217032, AxleTorq=0, BattSoc=0.9, BattCurr=2.567938068), struct(VehSpd=0, AxleTorq=6, BattSoc=0.9, BattCurr=0.6681536), struct(VehSpd=14.63542, AxleTorq=-246, BattSoc=0.9, BattCurr=-31.52964), struct(VehSpd=0, AxleTorq=6, BattSoc=0.9, BattCurr=0.4645685), struct(VehSpd=14.0625, AxleTorq=-248, BattSoc=0.9, BattCurr=-26.28464), struct(VehSpd=0, AxleTorq=6, BattSoc=0.9, BattCurr=0.3119529), struct(VehSpd=14.7309, AxleTorq=-246, BattSoc=0.9, BattCurr=-30.51351), struct(VehSpd=0, AxleTorq=6, BattSoc=0.9, BattCurr=0.6681536), struct(VehSpd=14.63542, AxleTorq=-246, BattSoc=0.9, BattCurr=-31.52964), struct(VehSpd=0, AxleTorq=6, BattSoc=0.9, BattCurr=0.4645685), struct(VehSpd=14.0625, AxleTorq=-248, BattSoc=0.9, BattCurr=-26.28464), struct(VehSpd=0, AxleTorq=6, BattSoc=0.9, BattCurr=0.3119529), struct(VehSpd=14.7309, AxleTorq=-246, BattSoc=0.9, BattCurr=-30.51351), struct(VehSpd=14.59201, AxleTorq=-246, BattSoc=0.9, BattCurr=-30.64489), struct(VehSpd=14.921875, AxleTorq=-246, BattSoc=0.9, BattCurr=-31.85597), struct(VehSpd=14.94792, AxleTorq=-244, BattSoc=0.9, BattCurr=-31.92191), struct(VehSpd=14.14931, AxleTorq=-246, BattSoc=0.9, BattCurr=-28.37443)]