% Simulink data dictionary DdChassis.sldd

ChassisNumFrontWhls = 2
ChassisNumRearWhls = 2
ChassisDistCg2FrontAxle = 1.188
ChassisDistCg2RearAxle = 1.512
ChassisCgHeight = 0.5
ChassisVehMass = 1624
ChassisDragCoeff = 0.32
ChassisFrontalArea = 2.816123
Ref_Spd0229 = [13 13.007895099 13.015778396 13.023649891 13.031509584 13.039357475 13.047193564 13.055017851 13.062830336 13.070631019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 15]
Ref_Time0229 = [0 0.01 0.02 0.03 0.04 0.05 0.06 0.07 0.08 0.09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 26.68]